# Grasshopper definition Final_circle_generator.gh (Grasshopper 1.0.7)
# Copyright: Armin Seltz
# Copyright: Use it.  Mod it.  Share it. Just please give credit and keep this party going.
# Copyright: Use it.  Mod it.  Share it. Just please give credit and kepp this party going.
# plug-ins: MetaHopper, Pufferfish

# ---- group: Machine parameters
toolhead = ValueList({"FIL11": "T3", "FIL33 (E0)": "T0", "FIL33 (E1)": "T1", "FIL33 (E2)": "T2", "LIQ11": "T10", "LIQ21": "T13", "PAS11": "T20"}, selected="LIQ21")
material = ValueList({"COPSIL40", "Porcelain", "Mono_Joint": "Mono_joint"}, selected="COPSIL40")

# ---- group: Printing Parameters
seam_position = Slider(0, range=0..1)
layer_height_mm = Slider(0.7, range=0..2)
layer_height_compressed_mm = Slider(0.35, range=0..2)
nozzle_diameter_mm = Slider(1.04, range=0..2)
printing_speed_mm_s = Slider(4.5, range=0..200)
nozzle_lift_mm = Slider(1, range=0..2)
retraction_lenght_mm = Slider(0.3, range=0..2)
retraction_speed_mm_s = Slider(140, range=0..200)
extrusion_factor = Slider(1, range=0..2)
segment_number = Slider(80, range=0..200)
travel_speed_mm_s = Slider(70, range=0..200)

# ---- group: Param bottom
tolerance = Slider(0.04, range=0..1)
perimeter_wall = Slider(1, range=0..5)
infill_ratio = Slider(1, range=0..1)

# ----
gcode_computation = BooleanToggle(True)
enable_disable_object = EnableDisableObject(Enabled=gcode_computation, AllObjects_Object=[bounding_box_3, bounding_box_4, bounding_box, bounding_box_2])

# ---- group: mm/s -> mm/m
multiplication = Multiplication(A=printing_speed_mm_s, B="60")

multiplication_2 = Multiplication(A=travel_speed_mm_s, B="60")

# ---- group: Non-Linear Path Generator (Main)
brep = Brep(<brep referenced from the Rhino model>)
bounding_box = BoundingBox(Content=brep, Plane=PlaneXY(0, 0, 0))  # -> Box, Box_2
deconstruct_brep = DeconstructBrep(Brep=brep)  # -> graft(Faces), Edges, Vertices
deconstruct_box = DeconstructBox(Box=bounding_box.Box)  # -> Plane, X, Y, Z
deconstruct_domain = DeconstructDomain(Domain=deconstruct_box.Z)  # -> Start, End
subtraction = Subtraction(A=deconstruct_domain.End, B=deconstruct_domain.Start)
division = Division(A=subtraction, B=layer_height_mm)
range = Range(Domain=Domain(0, 1), Steps=division)
construct_point = ConstructPoint(XCoordinate=range, YCoordinate=0, ZCoordinate=0)
iso_curve = IsoCurve(Surface=reparameterize(deconstruct_brep.Faces), UVPoint=construct_point)  # -> UIsocurve, flatten(VIsocurve)
join_curves = JoinCurves(Curves=iso_curve.VIsocurve, Preserve=False)
evaluate_curve = EvaluateCurve(Curve=reparameterize(join_curves), Parameter=seam_position)  # -> Point, Tangent, Angle
deconstruct = Deconstruct(Point=evaluate_curve.Point)  # -> XComponent, YComponent, ZComponent
sort_list = SortList(Keys=deconstruct.ZComponent, ValuesValuesA=join_curves)  # -> Keys, ValuesValuesA

# ---- group: Non-Linear Path Generator (compressed)
# MAIN LAYER PATH GENERATOR: - Take 2 surfaces : Main and Compressed.
# 
# - Generate a list of curve corresponding to the path for the nozzle with deffirent layer height.
brep_2 = Brep(<brep referenced from the Rhino model>)
bounding_box_2 = BoundingBox(Content=brep_2, Plane=PlaneXY(0, 0, 0))  # -> Box, Box_2
deconstruct_brep_2 = DeconstructBrep(Brep=brep_2)  # -> graft(Faces), Edges, Vertices
deconstruct_box_2 = DeconstructBox(Box=bounding_box_2.Box)  # -> Plane, X, Y, Z
deconstruct_domain_2 = DeconstructDomain(Domain=deconstruct_box_2.Z)  # -> Start, End
subtraction_2 = Subtraction(A=deconstruct_domain_2.End, B=deconstruct_domain_2.Start)
division_2 = Division(A=subtraction_2, B=layer_height_compressed_mm)
range_2 = Range(Domain=Domain(0, 1), Steps=division_2)
construct_point_2 = ConstructPoint(XCoordinate=range_2, YCoordinate=0, ZCoordinate=0)
iso_curve_2 = IsoCurve(Surface=reparameterize(deconstruct_brep_2.Faces), UVPoint=construct_point_2)  # -> UIsocurve, flatten(VIsocurve)
join_curves_2 = JoinCurves(Curves=iso_curve_2.VIsocurve, Preserve=False)
evaluate_curve_2 = EvaluateCurve(Curve=reparameterize(join_curves_2), Parameter=seam_position)  # -> Point, Tangent, Angle
deconstruct_2 = Deconstruct(Point=evaluate_curve_2.Point)  # -> XComponent, YComponent, ZComponent
sort_list_2 = SortList(Keys=deconstruct_2.ZComponent, ValuesValuesA=join_curves_2)  # -> Keys, ValuesValuesA

# ---- group: Z-level sort / Sort by height
merge = Merge(Data1=sort_list_2.Keys, Data2=sort_list.Keys)
merge_2 = Merge(Data1=sort_list_2.ValuesValuesA, Data2=sort_list.ValuesValuesA)
sort_list_3 = SortList(Keys=merge, ValuesValuesA=merge_2)  # -> Keys, ValuesValuesA

# ---- group: Z-level sort / Height position
list_length = ListLength(List=sort_list_2.ValuesValuesA)
list_length_2 = ListLength(List=sort_list.ValuesValuesA)
integer = Integer(1)
integer_2 = Integer(0)
integer_3 = Integer(0)
series = Series(Start=integer, Step=integer_2, Count=list_length)
series_2 = Series(Start=integer_3, Step=integer_3, Count=list_length_2)
merge_3 = Merge(Data1=series, Data2=series_2)
sort_list_4 = SortList(Keys=merge, ValuesValuesA=merge_3)  # -> Keys, ValuesValuesA
integer_4 = Integer([0, 1])
cull_index = CullIndex(List=sort_list_4.ValuesValuesA, Indices=integer_4, Wrap=True)

# ---- group: Z-level sort / Path Discretisation
subtraction_3 = Subtraction(A=segment_number, B="1")
divide_curve = DivideCurve(Curve=sort_list_3.ValuesValuesA, Count=subtraction_3, Kinks=False)  # -> Points, Tangents, Parameters

# ---- group: Z-level sort / Remove bottom
simplify_tree = SimplifyTree(Tree=divide_curve.Points, Front=False)
tree_statistics = TreeStatistics(Tree=simplify_tree)  # -> Paths, Length, Count
integer_5 = Integer([0, 1])
# NOZZLE PATH SORTER: - Sort the nozzle path depending of their Z value
cull_index_2 = CullIndex(List=tree_statistics.Paths, Indices=integer_5, Wrap=True)
split_tree = SplitTree(Data=simplify_tree, Masks=flatten(cull_index_2))  # -> Positive, Negative

# ---- group: Extrusion Flow Regulator / Section Length
polyline = PolyLine(Vertices=flatten(split_tree.Positive), Closed=False)
explode = Explode(Curve=polyline, Recursive=True)  # -> Segments, Vertices
length = Length(Curve=explode.Segments)  # -> flatten(Length)

# ----
list_length_3 = ListLength(List=flatten(split_tree.Positive))
subtraction_4 = Subtraction(A=list_length_3, B="1")
list_item = ListItem(List=length, Index=0, Wrap=True)
integer_6 = Integer(0)
series_3 = Series(Start=list_item, Step=integer_6, Count=subtraction_4)

# ---- group: Extrusion Flow Regulator / Jump layer En to 0
list_length_4 = ListLength(List=merge_2)
subtraction_5 = Subtraction(A=list_length_4, B="3")
stack_data = StackData(Data=segment_number, Stack=list_length_4)
mass_addition = MassAddition(Input=stack_data)  # -> Result, PartialResults
subtraction_6 = Subtraction(A=mass_addition.PartialResults, B="1")
split_list = SplitList(List=subtraction_6, Index=subtraction_5)  # -> ListA, ListB

# ---- group: Start Script
panel = Panel("""T999
G28 				;Home extruder			  
G90 				;Absolute positioning			  
G1 X0 Y0 Z150 F15000 	 	;Parking position		
M207 S0 R0 F10000 Z0				      				    			  """)
panel_2 = Panel("""M82
G92 E0.000""")
entwine = Entwine(
    Branch00="; G-Code generated by Simplify3D(R) Version 4.1.2",
    Branch01=panel,
    Branch02=toolhead,
    Branch03=panel_2,
    FlattenInputs=True)  # -> flatten(Result)

# ---- group: End Script
panel_3 = Panel(""";End Gcode	   
G91                                     ; Relative axis positioning
G0 Z30 F3600                            ; Move tool out of the part
G10 L2 Z0				; Reset origin offset
G90                                    ; Absolute axis positioning
G0 X0 Y0                             ; Move tool out of the part
G28                                     ; Home extruder
M207 S0 R0 F10000 Z0                    ; Define tool change retraction settings
T999                                ; Deselect Tool

	""")

# ---- group: File Export & Preview
pick_folder = Button()
filename = Panel("Test")
write_gcode = Button()
replace_text = ReplaceText(Text=layer_height_mm, Find=".", RecursiveReplace=False)
replace_text_2 = ReplaceText(Text=nozzle_diameter_mm, Find=".", RecursiveReplace=False)
panel_4 = Panel("{0}_{1}_{2}_LH{3}_EW{4}")
format = Format(
    Format="{0}_{1}_{2}",
    Culture=127,
    Data0=toolhead,
    Data1=material,
    Data2=filename,
    Data3=replace_text,
    Data4=replace_text_2)
preview_gcode = Button()

# ---- group: Exterior Bottom Path-Generator
# BOTTOM LAYER PATH GENERATOR: - Take 2 surfaces : Interior and exterior.
# 
# - Generate a list of curve corresponding to the path for the nozzle
brep_3 = Brep(<brep referenced from the Rhino model>)
bounding_box_3 = BoundingBox(Content=brep_3, Plane=PlaneXY(0, 0, 0))  # -> Box, Box_2
deconstruct_brep_3 = DeconstructBrep(Brep=brep_3)  # -> graft(Faces), Edges, Vertices
deconstruct_box_3 = DeconstructBox(Box=bounding_box_3.Box)  # -> Plane, X, Y, Z
deconstruct_domain_3 = DeconstructDomain(Domain=deconstruct_box_3.Z)  # -> Start, End

# ----
subtraction_7 = Subtraction(A=deconstruct_domain_3.End, B=deconstruct_domain_3.Start)

# ---- group: Exterior Bottom Path-Generator (continued)
division_3 = Division(A=subtraction_7, B=layer_height_mm)
range_3 = Range(Domain=Domain(0, 1), Steps=division_3)
construct_point_3 = ConstructPoint(XCoordinate=range_3, YCoordinate=0, ZCoordinate=0)
iso_curve_3 = IsoCurve(Surface=reparameterize(deconstruct_brep_3.Faces), UVPoint=construct_point_3)  # -> UIsocurve, flatten(VIsocurve)
join_curves_3 = JoinCurves(Curves=iso_curve_3.VIsocurve, Preserve=False)
seam = Seam(Curve=reparameterize(join_curves_3), Seam=seam_position)
evaluate_curve_3 = EvaluateCurve(Curve=reparameterize(join_curves_3), Parameter=seam_position)  # -> Point, Tangent, Angle
deconstruct_3 = Deconstruct(Point=evaluate_curve_3.Point)  # -> XComponent, YComponent, ZComponent
sort_list_5 = SortList(Keys=deconstruct_3.ZComponent, ValuesValuesA=seam)  # -> Keys, ValuesValuesA

# ---- group: Interior Bottom Path-Generator
brep_4 = Brep(<brep referenced from the Rhino model>)
bounding_box_4 = BoundingBox(Content=brep_4, Plane=PlaneXY(0, 0, 0))  # -> Box, Box_2
deconstruct_brep_4 = DeconstructBrep(Brep=brep_4)  # -> graft(Faces), Edges, Vertices
deconstruct_box_4 = DeconstructBox(Box=bounding_box_4.Box)  # -> Plane, X, Y, Z
deconstruct_domain_4 = DeconstructDomain(Domain=deconstruct_box_4.Z)  # -> Start, End

# ----
subtraction_8 = Subtraction(A=deconstruct_domain_4.End, B=deconstruct_domain_4.Start)

# ---- group: Interior Bottom Path-Generator (continued)
division_4 = Division(A=subtraction_8, B=layer_height_mm)
range_4 = Range(Domain=Domain(0, 1), Steps=division_4)
construct_point_4 = ConstructPoint(XCoordinate=range_4, YCoordinate=0, ZCoordinate=0)
iso_curve_4 = IsoCurve(Surface=reparameterize(deconstruct_brep_4.Faces), UVPoint=construct_point_4)  # -> UIsocurve, flatten(VIsocurve)
join_curves_4 = JoinCurves(Curves=iso_curve_4.VIsocurve, Preserve=False)
seam_2 = Seam(Curve=reparameterize(join_curves_4), Seam=seam_position)
evaluate_curve_4 = EvaluateCurve(Curve=reparameterize(join_curves_4), Parameter=seam_position)  # -> Point, Tangent, Angle
deconstruct_4 = Deconstruct(Point=evaluate_curve_4.Point)  # -> XComponent, YComponent, ZComponent
sort_list_6 = SortList(Keys=deconstruct_4.ZComponent, ValuesValuesA=seam_2)  # -> Keys, ValuesValuesA

# ---- group: Bottom Infill discretisation / Compensate offset of xylinus
division_5 = Division(A=nozzle_diameter_mm, B="2")
division_6 = Division(A=nozzle_diameter_mm, B="2")
offset_in = OffsetIn(curve=sort_list_6.ValuesValuesA, distance=division_6, corner_style=3)  # -> offset_cruves, possibly_problematic_curves
offset_out = OffsetOut(curve=sort_list_5.ValuesValuesA, distance=division_5, corner_style=3)  # -> crv_5, possibly_problematic_curves

# ---- group: Bottom Infill discretisation
# BOTTOM INFILL GENERATOR: - Use Xylinus extension to generate infill path
# 
# - May present several defect
curves_with_infill_compound = CurvesWithInfillCompound(
    exterior_curves=offset_out.crv_5,
    interior_curves=offset_in.offset_cruves,
    xy_tolereance_or_or_xylinus_config=tolerance,
    extrusion_width_or_xylinus_config=nozzle_diameter_mm,
    perimenter_wall_count=perimeter_wall,
    infill_ratio_0_1=infill_ratio)  # -> crv_5, perimeters_and_infilll_as_polylines, perimeters, infill_2

# ---- group: Bottom Infill discretisation / Sort by Z
cp = ControlPoints(Curve=curves_with_infill_compound.perimeters)  # -> Points, Weights, Knots
deconstruct_5 = Deconstruct(Point=cp.Points)  # -> XComponent, YComponent, simplify(ZComponent)
average = Average(Input=deconstruct_5.ZComponent)  # -> flatten(ArithmeticMean)
sort_list_7 = SortList(Keys=average, ValuesValuesA=curves_with_infill_compound.perimeters)  # -> Keys, ValuesValuesA

cp_2 = ControlPoints(Curve=curves_with_infill_compound.infill_2)  # -> Points, Weights, Knots
deconstruct_6 = Deconstruct(Point=cp_2.Points)  # -> XComponent, YComponent, simplify(ZComponent)
average_2 = Average(Input=deconstruct_6.ZComponent)  # -> flatten(ArithmeticMean)
sort_list_8 = SortList(Keys=average_2, ValuesValuesA=curves_with_infill_compound.infill_2)  # -> Keys, ValuesValuesA

# ---- group: Extrusion Flow Regulator / Extrusion value
# EXTRUSION FLOW REGULATOR: - Generate flow extrusion depending of the layer height
dispatch = Dispatch(List=tree_statistics.Paths, DispatchPattern=sort_list_4.ValuesValuesA)  # -> ListA, ListB
simplify_tree_2 = SimplifyTree(Tree=divide_curve.Points, Front=False)
split_tree_2 = SplitTree(Data=simplify_tree_2, Masks=flatten(dispatch.ListA))  # -> Positive, Negative
volume_extrusion_mm3 = Panel("2.4")

# ---- group: Extrusion Flow Regulator / Variable Layer Height
flip_matrix = FlipMatrix(Data=split_tree_2.Positive)
polyline_2 = PolyLine(Vertices=flip_matrix, Closed=False)
explode_2 = Explode(Curve=polyline_2, Recursive=True)  # -> Segments, Vertices
end_points = EndPoints(Curve=explode_2.Segments)  # -> Start, End
vector_2pt = Vector2Pt(PointA=end_points.Start, PointB=end_points.End, Unitize=False)  # -> Vector, Length
flip_matrix_2 = FlipMatrix(Data=vector_2pt.Vector)
vector_length = VectorLength(Vector=flip_matrix_2)

flip_matrix_3 = FlipMatrix(Data=split_tree_2.Negative)
polyline_3 = PolyLine(Vertices=flip_matrix_3, Closed=False)
explode_3 = Explode(Curve=polyline_3, Recursive=True)  # -> Segments, Vertices
end_points_2 = EndPoints(Curve=explode_3.Segments)  # -> Start, End
vector_2pt_2 = Vector2Pt(PointA=end_points_2.Start, PointB=end_points_2.End, Unitize=False)  # -> Vector, Length
flip_matrix_4 = FlipMatrix(Data=vector_2pt_2.Vector)
vector_length_2 = VectorLength(Vector=flip_matrix_4)

# ---- group: Extrusion Flow 1 (bottom) / Extrusion value / Height Length
relative_differences = RelativeDifferences(Values=sort_list_7.Keys)

# ---- group: Bottom Infill discretisation / Sort the Infill and Perimeters Paths
create_set = CreateSet(List=average_2)  # -> Set, Map
create_set_2 = CreateSet(List=create_set.Map)  # -> Set, Map
nb_surfaces = Panel("2")
member_index = MemberIndex(Set=create_set.Map, Member=create_set_2.Set)  # -> Index, Count
series_4 = Series(Start="1", Step="0", Count=member_index.Count)

# ----
multiplication_3 = Multiplication(A=nb_surfaces, B=perimeter_wall)

# ---- group: Bottom Infill discretisation / Sort the Infill and Perimeters Paths (continued)
series_5 = Series(Start="0", Step="0", Count=multiplication_3)
insert_items = InsertItems(List=series_4, Item=series_5, Indices="0", Wrap=True)
weave = Weave(Pattern=flatten(insert_items), Stream0=sort_list_7.ValuesValuesA, Stream1=sort_list_8.ValuesValuesA, NullGaps=False)
cp_3 = ControlPoints(Curve=weave)  # -> Points, Weights, Knots

# ---- group: Bottom Infill discretisation / Remove First Bottom Path
list_length_5 = ListLength(List=insert_items)  # -> flatten(Length)
split_list_2 = SplitList(List=list_length_5, Index="1")  # -> ListA, ListB
series_6 = Series(Start="0", Step="1", Count=split_list_2.ListA)
simplify_tree_3 = SimplifyTree(Tree=cp_3.Points, Front=False)
tree_statistics_2 = TreeStatistics(Tree=simplify_tree_3)  # -> Paths, Length, Count
cull_index_3 = CullIndex(List=tree_statistics_2.Paths, Indices=series_6, Wrap=True)
split_tree_3 = SplitTree(Data=simplify_tree_3, Masks=flatten(cull_index_3))  # -> Positive, Negative

# ---- group: Extrusion Flow 1 (bottom) / Extrusion value / Section Length
polyline_4 = PolyLine(Vertices=flatten(split_tree_3.Positive), Closed=False)
explode_4 = Explode(Curve=polyline_4, Recursive=True)  # -> Segments, Vertices
length_2 = Length(Curve=explode_4.Segments)  # -> flatten(Length)

# ---- group: Extrusion Flow 1 (bottom) / Jump layer En to 0
list_length_6 = ListLength(List=split_tree_3.Positive)  # -> flatten(Length)
list_length_7 = ListLength(List=list_length_6)
mass_addition_2 = MassAddition(Input=list_length_6)  # -> Result, PartialResults
subtraction_9 = Subtraction(A=list_length_7, B="1")
subtraction_10 = Subtraction(A=mass_addition_2.PartialResults, B="1")
split_list_3 = SplitList(List=subtraction_10, Index=subtraction_9)  # -> ListA, ListB

# ---- group: Extrusion Flow 1 (bottom) / Extrusion value / Height Length (continued)
list_item_2 = ListItem(List=relative_differences, Index=multiplication_3, Wrap=True)
list_length_8 = ListLength(List=length_2)
stack_data_2 = StackData(Data=list_item_2, Stack=list_length_8)

# ---- group: Seam Command Generator
list_length_9 = ListLength(List=split_tree_3.Positive)
list_length_10 = ListLength(List=split_tree.Positive)
entwine_2 = Entwine(Branch00=split_tree_3.Positive, Branch01=split_tree.Positive, FlattenInputs=True)  # -> flatten(Result)
entwine_3 = Entwine(Branch00=list_length_9, Branch01=list_length_10, FlattenInputs=True)  # -> flatten(Result)
mass_addition_3 = MassAddition(Input=entwine_3)  # -> Result, PartialResults
subtraction_11 = Subtraction(A=mass_addition_3.PartialResults, B="1")
list_item_3 = ListItem(List=entwine_2, Index=subtraction_11, Wrap=True)
list_item_4 = ListItem(List=entwine_2, Index=mass_addition_3.PartialResults, Wrap=True)
last_index = LastIndex(List=list_item_3)
last_index_2 = LastIndex(List=list_item_4)
cull_index_4 = CullIndex(List=list_item_3, Indices=last_index, Wrap=True)
cull_index_5 = CullIndex(List=list_item_4, Indices=last_index_2, Wrap=True)
deconstruct_7 = Deconstruct(Point=flatten(cull_index_5))  # -> XComponent, YComponent, ZComponent
deconstruct_8 = Deconstruct(Point=flatten(cull_index_4))  # -> XComponent, YComponent, ZComponent
expression = Expression(x=deconstruct_7.XComponent, Expression="Format(\"{0:0.000}\",x)")
expression_2 = Expression(y=deconstruct_7.YComponent, Expression="Format(\"{0:0.000}\",y)")
expression_3 = Expression(z=deconstruct_7.ZComponent, Expression="Format(\"{0:0.000}\",z)")
expression_4 = Expression(x=deconstruct_8.XComponent, Expression="Format(\"{0:0.000}\",x)")
expression_5 = Expression(y=deconstruct_8.YComponent, Expression="Format(\"{0:0.000}\",y)")
expression_6 = Expression(z=deconstruct_8.ZComponent, Expression="Format(\"{0:0.000}\",z)")
negative = Negative(Value=retraction_lenght_mm)
negative_2 = Negative(Value=retraction_lenght_mm)
addition = Addition(A=expression_3, B=nozzle_lift_mm)
addition_2 = Addition(A=expression_6, B=nozzle_lift_mm)
concatenate = Concatenate(
    FragmentM="G92 ",
    FragmentL="E0.000",
    FragmentK="G1",
    FragmentJ=" F",
    FragmentI=multiplication_2,
    FragmentA=" X",
    FragmentB=expression_4,
    FragmentC=" Y",
    FragmentD=expression_5,
    FragmentE=" Z",
    FragmentF=addition_2,
    FragmentG=" E",
    FragmentH=negative_2,
    FragmentN="G1",
    FragmentO=" F",
    FragmentP=multiplication_2,
    FragmentQ=" X",
    FragmentR=expression,
    FragmentS=" Y",
    FragmentT=expression_2,
    FragmentU=" Z",
    FragmentV=addition,
    FragmentW=" E",
    FragmentX=negative)

# ---- group: Extrusion Flow 1 (bottom)
# EXTRUSION FLOW REGULATOR: - Generate flow extrusion depending of the layer height
hard_change = Panel("0.95")

# ---- group: Extrusion Flow 1 (bottom) / Extrusion value
volume_extrusion_mm3_2 = Panel("2.4")
material_volume = Multiplication(A=hard_change, B=extrusion_factor, C=nozzle_diameter_mm, D=length_2, E=stack_data_2)
division_7 = Division(A=material_volume, B=volume_extrusion_mm3_2)

# ---- group: Extrusion Flow 1 (bottom) (continued)
partition_list = PartitionList(List=division_7, Size=list_length_6)
mass_addition_4 = MassAddition(Input=partition_list)  # -> Result, flatten(PartialResults)
replace_items = ReplaceItems(List=mass_addition_4.PartialResults, Item="0", Indices=split_list_3.ListA, Wrap=False)
insert_items_2 = InsertItems(List=replace_items, Item="0", Indices="0", Wrap=True)
expression_7 = Expression(E=insert_items_2, Expression="Format(\"{0:0.000}\",E)")

# ---- group: Extrusion Flow Regulator
series_7 = Series(Start=cull_index, Step="0", Count=segment_number)  # -> flatten(Series)

# ---- group: Extrusion Flow Regulator / Extrusion value (continued)
weave_2 = Weave(Pattern=series_7, Stream0=flatten(vector_length_2), Stream1=flatten(vector_length), NullGaps=False)
cull_index_6 = CullIndex(List=flatten(weave_2), Indices="0", Wrap=True)  # -> flatten(List)
material_volume_2 = Multiplication(A=extrusion_factor, B=nozzle_diameter_mm, C=series_3, D=cull_index_6)
division_8 = Division(A=material_volume_2, B=volume_extrusion_mm3)

# ---- group: Extrusion Flow Regulator (continued)
partition_list_2 = PartitionList(List=division_8, Size=segment_number)
mass_addition_5 = MassAddition(Input=partition_list_2)  # -> Result, flatten(PartialResults)
replace_items_2 = ReplaceItems(List=mass_addition_5.PartialResults, Item="0", Indices=split_list.ListA, Wrap=False)
insert_items_3 = InsertItems(List=replace_items_2, Item="0", Indices="0", Wrap=True)
expression_8 = Expression(E=insert_items_3, Expression="Format(\"{0:0.000}\",E)")

# ----
entwine_4 = Entwine(Branch00=expression_7, Branch01=expression_8, FlattenInputs=True)  # -> flatten(Result)

# ---- group: G-code Builder
entwine_5 = Entwine(Branch00=split_tree_3.Positive, Branch01=split_tree.Positive, FlattenInputs=True)
deconstruct_9 = Deconstruct(Point=flatten(entwine_5))  # -> XComponent, YComponent, ZComponent
expression_9 = Expression(x=deconstruct_9.XComponent, Expression="Format(\"{0:0.000}\",x)")
expression_10 = Expression(y=deconstruct_9.YComponent, Expression="Format(\"{0:0.000}\",y)")
expression_11 = Expression(z=deconstruct_9.ZComponent, Expression="Format(\"{0:0.000}\",z)")
concatenate_2 = Concatenate(
    FragmentK="G1",
    FragmentJ=" F",
    FragmentI=multiplication,
    FragmentA=" X",
    FragmentB=expression_9,
    FragmentC=" Y",
    FragmentD=expression_10,
    FragmentE=" Z",
    FragmentF=expression_11,
    FragmentG=" E",
    FragmentH=entwine_4)

# ---- group: Layer-End
list_length_11 = ListLength(List=concatenate)
list_length_12 = ListLength(List=split_tree_3.Positive)  # -> flatten(Length)
list_length_13 = ListLength(List=split_tree.Positive)  # -> flatten(Length)
concatenate_3 = Concatenate(FragmentA="G92 ", FragmentB="E0.000")
merge_4 = Merge(Data1=list_length_12, Data2=list_length_13)
mass_addition_6 = MassAddition(Input=merge_4)  # -> Result, PartialResults
list_length_14 = ListLength(List=mass_addition_6.PartialResults)
subtraction_12 = Subtraction(A=list_length_14, B=list_length_11)
duplicate_data = DuplicateData(Data=concatenate_3, Number=subtraction_12, Order=True)
entwine_6 = Entwine(Branch00=concatenate, Branch01=duplicate_data, FlattenInputs=True)  # -> flatten(Result)
insert_items_4 = InsertItems(List=concatenate_2, Item=entwine_6, Indices=mass_addition_6.PartialResults, Wrap=True)

# ----
merge_5 = Merge(Data1=entwine, Data2=flatten(insert_items_4), Data3=panel_3)

# ---- group: File Export & Preview (continued)
# USER GUIDE: 1) Set the printing parameter at bottom left.
# 
# 2) Set the exportation for the file at left.
# 
# 3) Select the bottom surfaces and main surfaces from your rhino model with Brep block at the beginning of the 4 green box at right.
# 
# 4) Change the start and end script if needed.
# 
# 5) Save your file or directly copy and paste the G-code.
save_text_file_to_folder = SaveTextFileToFolder(
    text_data=flatten(merge_5),
    select_folder=pick_folder,
    file_name=format,
    write_txt=write_gcode,
    write_txt_2=preview_gcode)
folder = Panel(save_text_file_to_folder)

# ----
panel_5 = Panel(merge_5)

# ==== cluster SaveTextFileToFolder: Saves text data to a .txt file. You can choose a folder using the system dialog and specify a file name. The file ending .txt is appended automatically.
select_folder = ClusterInput()
file_name = ClusterInput()
write_txt = ClusterInput()
text_data = ClusterInput()
write_txt_2 = ClusterInput()
write_txt_3 = Boolean(write_txt)
select_folder_2 = Boolean(select_folder)
file_name_2 = Text(file_name)
text_data_2 = Text(text_data)
write_txt_4 = Boolean(write_txt_2)

# ---- group: Serialisation cannot be overriden in script components, therefore hacking it with a panel is an alternative
savepanel = Panel("C:\")

# ----
c_script = CSharpScript(select=select_folder_2, spNickname="Savepanel")  # -> out, dir; inputs select: Boolean, spNickname: String
# ---------- c_script: C# ----------
    try
    {
      string startupPath = Application.StartupPath;
      string folder = "";
      if (select == true) {
        using (FolderBrowserDialog dialog = new FolderBrowserDialog())
        {
          dialog.Description = "Open a folder ";
          dialog.ShowNewFolderButton = true;
          dialog.RootFolder = Environment.SpecialFolder.MyComputer;
          if(dialog.ShowDialog() == DialogResult.OK)
          {
            folder = dialog.SelectedPath;
            // set savepane
            SetSavePanel(spNickname, folder);
          }
        }
      }
    }
    catch (Exception)
    {
      MessageBox.Show("Folder selection failed!");
    }

    // get path from savepanel
    dir = GetFromSavePanel(spNickname);
# ---------- c_script: C# additional code ----------
  private void SetSavePanel(string panelNickname, string path)
  {
    for (int i = 0; i < GrasshopperDocument.Objects.Count; i++)
    {
      if (GrasshopperDocument.Objects[i].ToString() == "Grasshopper.Kernel.Special.GH_Panel")
      {
        Grasshopper.Kernel.Special.GH_Panel panel = (Grasshopper.Kernel.Special.GH_Panel) GrasshopperDocument.Objects[i];

        if (panel.NickName == panelNickname)
        {
          panel.SetUserText(path);
        }
      }
    }
  }
  private string GetFromSavePanel(string panelNickname)
  {
    for (int i = 0; i < GrasshopperDocument.Objects.Count; i++)
    {
      if (GrasshopperDocument.Objects[i].ToString() == "Grasshopper.Kernel.Special.GH_Panel")
      {
        Grasshopper.Kernel.Special.GH_Panel panel = (Grasshopper.Kernel.Special.GH_Panel) GrasshopperDocument.Objects[i];

        if (panel.NickName == panelNickname)
        {
          return panel.UserText;
        }
      }
    }
    return "";
  }
# ---------- end c_script ----------
clear = Boolean(write_txt_4)

# ---- group: Save Scatter Data
concat = Concatenate(FragmentC=c_script.dir, FragmentD="\", FragmentA=file_name_2, FragmentB=".gcode")
clear_2 = Boolean(Button())
path = FilePath(concat)
str = String(text_data_2)
P = Boolean(False)
txtwriter = VBScript(filePath=path, data=str, append=P, activate=write_txt_3, openFile=clear, clearFile=clear_2)  # -> out, A; inputs data: list
# ---------- txtwriter: VB usings ----------
Imports System.IO
Imports System.Linq
Imports System.Data
Imports System.Drawing
Imports System.Reflection
Imports System.Windows.Forms
Imports System.Xml
Imports System.Xml.Linq
Imports Microsoft.VisualBasic
Imports System.Runtime.InteropServices

Imports Rhino.DocObjects
Imports Rhino.Collections
Imports GH_IO
Imports GH_IO.Serialization
# ---------- txtwriter: VB ----------
    If activate Then

      Dim i As Integer
      Dim aryText(4) As String

      aryText(0) = "Mary WriteLine"
      aryText(1) = "Had"
      aryText(2) = "Another"
      aryText(3) = "Little"
      aryText(4) = "One"

      ' the data is appended to the file. If file doesnt exist, a new file is created
      Dim objWriter As New System.IO.StreamWriter(filePath, append)

      For i = 0 To data.Count - 1
        objWriter.WriteLine(data(i))
      Next

      objWriter.Close()

    End If

    If clearFile Then
      Dim objWriter As New System.IO.StreamWriter(filePath, False)
      objWriter.Close()
    End If

    If openFile Then
      If System.IO.File.Exists(filePath) = True Then
        System.Diagnostics.Process.Start(filePath)
      Else
        MsgBox("File Does Not Exist")
      End If

    End If
# ---------- end txtwriter ----------

# ----
folder = Text(savepanel)
folder_2 = ClusterOutput(folder)

# ==== cluster CurvesWithInfillCompound: offsets curves by 1/2 the extrusion witdth. External cuves are offset to the inside, and internal curves are offset out. There are a number of checks that attempt to fix the bugs in the Rhino/GH offset command.
exterior_curves = ClusterInput()
interior_curves = ClusterInput()
xy_tolereance_or_or_xylinus_config = ClusterInput()  # XY Tolerance
extrusion_width_or_xylinus_config = ClusterInput()  # input either the extrusion width in mm, or a Xlinus Config
perimenter_wall_count = ClusterInput()  # number of solid perimeter walls to print
infill_ratio_0_1 = ClusterInput()  # Set the density of the infill from 0 (none) to 1 solid).

list = ValueList({"0", "1", "2", "3", "4", "5", "6", "7", "8", "9", "10", "11", "12", "13", "14", "15", "16", "17", "18", "19", "20"}, selected="4")
setting = ConfigSetting(config=extrusion_width_or_xylinus_config, setting_number=list)
extrusion_width = Number(flatten(setting))

list_2 = ValueList({"0", "1", "2", "3", "4", "5", "6", "7", "8", "9", "10", "11", "12", "13", "14", "15", "16", "17", "18", "19", "20"}, selected="2")
crv = Curve(interior_curves)
crv_2 = Curve(exterior_curves)
setting_2 = ConfigSetting(config=xy_tolereance_or_or_xylinus_config, setting_number=list_2)
xy_tol = Number(flatten(setting_2))
num = Number(infill_ratio_0_1)
int = Integer(perimenter_wall_count)

series = Series(Start=expr("x/2", extrusion_width), Step=extrusion_width, Count=int)
trim = TrimTree(Tree=series, Depth=1)

# ---- group: make walls
item = ListItem(List=trim, Index=0, Wrap=True)  # -> Item1, Item
addition = Addition(A=item.Item1, B=extrusion_width)

# ----
offset_cmpnd = OffsetCompound(outside_crvs=crv_2, inside_crvs=crv, distance=addition)  # -> offset_curves, crv_2
offset_cmpnd_2 = OffsetCompound(outside_crvs=crv_2, inside_crvs=crv, distance=trim)  # -> offset_curves, crv_2

# ---- group: infill and collate
topoly = CurveToPolyline(Curve=offset_cmpnd_2.offset_curves, ToleranceDistance=xy_tol, ToleranceAngle=0)  # -> Polyline, Segments
infill = CurveInfill(C=offset_cmpnd.offset_curves, extrusion_width_or_xylinus_config=extrusion_width, infill_ratio_0_1=num)
trim_to = TrimTo(data_to_trim=simplify(infill), branch_depth=1, F=False)  # -> D, input_branch_depth
trim_to_2 = TrimTo(data_to_trim=simplify(topoly.Polyline), branch_depth=1, F=False)  # -> D, input_branch_depth
merge = Merge(Data1=offset_cmpnd_2.offset_curves, Data2=infill)
merge_2 = Merge(Data1=trim_to_2.D, Data2=trim_to.D)
crv_3 = Curve(merge)
crv_4 = Curve(merge_2)

# ----
crv_5 = ClusterOutput(crv_3)
perimeters_and_infilll_as_polylines = ClusterOutput(crv_4)  # perimeters and infilll as polylines
perimeters = ClusterOutput(trim_to_2.D)  # perimeter walls as polylines
infill_2 = ClusterOutput(infill)  # infill as polylines

# ==== cluster ConfigSetting: If an individual specific setting is input in S, it will be returned. Otherwise the config (C) setting, matching the input ID will be passed. The ID is an integer matching the branch number of the desired setting. The returned setting will have the data structure matching the input ID. Is anything other than a Xylinus Config is input to C, that data will simply be passed to S.
config = ClusterInput()
setting_number = ClusterInput()  # input an integer matching the branch number of the desired setting.
data = Data(config)
int = Integer(setting_number)

# ---- group: is it a config?
branch = TreeBranch(Tree=data, Path="{0}", MaintainPaths=True)
tmatch = MatchText(Text=branch, RegEx="config", Case=False)
int_2 = Integer(tmatch)
null = NullItem(Item=int_2)  # -> NullFlags, InvalidFlags, Description
filter = StreamFilter(Gate=null.NullFlags, Stream0=int_2, Stream1=0)

# ----
path = ConstructPath(Indices=int)

# ---- group: if so, pull the requested setting
branch_2 = TreeBranch(Tree=data, Path=path, MaintainPaths=True)

# ---- group: otherwise, just pass the input data
filter_2 = StreamFilter(Gate=filter, Stream0=data, Stream1=branch_2)
data_2 = Data(filter_2)

# ---- group: if something is passed in the Setting, use that value.
setting = ClusterInput()  # Individual specific setting. Will override the config setting.
data_3 = Data(setting)
null_coalescing = NullCoalescing(primary_data=data_3, secondary_data=data_2)

# ---- group: make the data structure match what is expected from the input
replace = ReplacePaths(Data=flatten(null_coalescing), Search="{0}", Replace=path)
setting_2 = ClusterOutput(replace)

# ==== cluster TrimTo: Trim the branches of a tree to a target length.
branch_depth = ClusterInput()  # The target branch depth. A flat terr is 0. {0} is one. {0;0} is two. etc.
data_to_trim = ClusterInput()
int = Integer(branch_depth)
data = Data(data_to_trim)
tstat = TreeStatistics(Tree=data)  # -> Paths, Length, Count
F = ClusterInput()
trim_front = Boolean(F)
split = TextSplit(Text=tstat.Paths, Separators="{;}")
empty = Text("")
mindex = MemberIndex(Set=split, Member=empty)  # -> Index, Count
cull_i = CullIndex(List=split, Indices=mindex.Index, Wrap=True)
dom = ConstructDomain(DomainStart=0, DomainEnd=expr("x-1", int))

lng = ListLength(List=cull_i)
subtraction = Subtraction(A=lng, B=int)

match = MatchTree(Tree=lng, Guide=data)
max = Maximum(A=0, B=subtraction)

dom_2 = ConstructDomain(DomainStart=max, DomainEnd=expr("x-1", lng))

filter = StreamFilter(Gate=trim_front, Stream0=dom, Stream1=dom_2)
input_branch_depth = ClusterOutput(match)
subset = SubList(List=cull_i, Domain=filter, Wrap=False)  # -> List, Index
path = ConstructPath(Indices=subset.List)  # -> flatten(Branch)
replace = ReplacePaths(Data=data, Search=tstat.Paths, Replace=path)
D = ClusterOutput(replace)

# ==== cluster CurveInfill: Take the given curve and creates an infill (based on the extrusion width and infill ratio) of the curve as a polyline. This polyline can be then be converted into g code.

C = ClusterInput()
trim_to = TrimTo_2(data_to_trim=simplify(C), branch_depth=1, F=False)
crv = Curve(trim_to)
join = JoinCurves(Curves=crv, Preserve=False)
trim = TrimTree(Tree=join, Depth=1)
boundary = BoundarySurfaces(Edges=trim)  # -> graft(Surfaces)

extrusion_width_or_xylinus_config = ClusterInput()  # input either the extrusion width in mm, or a Xlinus Config
extrusion_width = Data(extrusion_width_or_xylinus_config)
setting = ConfigSetting(config=extrusion_width, setting_number=3)  # -> flatten(setting_2)

# ---- group: infill ratio
infill_ratio_0_1 = ClusterInput()  # infill ratio
division = Division(A=1, B=infill_ratio_0_1)
multiplication = Multiplication(A=setting, B=division)

# ----
tstat = TreeStatistics(Tree=crv)  # -> Paths, Length, Count
long = LongestList(ListA=tstat.Paths, ListB=[0, 1], PaddingMode=4)  # -> ListA, simplify(graft(ListB))
larger = LargerThan(FirstNumber=tstat.Count, SecondNumber=1)  # -> LargerThan, OrEqualTo
filter = StreamFilter(Gate=larger.LargerThan, Stream0=0, Stream1=long.ListB)
trim_2 = TrimTree(Tree=boundary, Depth=1)

# ---- group: create lines for infill
bbox = BoundingBox(Content=flatten(boundary), Plane=PlaneXY(0, 0, 0), UnionBox=True)  # -> Box, Box_2
box = EvaluateBox(Box=bbox.Box, UParameter=0.5, VParameter=0.5, WParameter=0.5)  # -> Plane, Point, Include
rotate = Rotate(Geometry=bbox.Box, Angle=1.570796327, Plane=box.Plane)  # -> Geometry, Transform
bbox_2 = BoundingBox(Content=flatten([rotate.Geometry, bbox.Box]), Plane=PlaneXY(0, 0, 0), UnionBox=True)  # -> Box, Box_2
box_corners = BoxCorners(Box=flatten(bbox_2.Box))  # -> CornerA, CornerB, CornerC, CornerD, CornerE, CornerF, CornerG, CornerH
ln = Line(StartPoint=box_corners.CornerA, EndPoint=box_corners.CornerC)

# ----
ln_2 = Line(StartPoint=box_corners.CornerB, EndPoint=box_corners.CornerD)
p_n_c = PickNChoose(Pattern=filter, Stream0=ln, Stream1=ln_2)
long_2 = LongestList(ListA=trim_2, ListB=p_n_c, PaddingMode=2)  # -> ListA, graft(ListB)

# ---- group: create lines for infill (continued)
divlength = DivideLength(Curve=long_2.ListB, Length=multiplication)  # -> Points, Tangents, Parameters
pl = PlaneNormal(Origin=divlength.Points, ZAxis=long_2.ListB)
trim_3 = TrimTree(Tree=pl, Depth=1)
sec = BrepPlane(Brep=boundary, Plane=trim_3)  # -> Curves, Points
clean = CleanTree(RemoveNulls=True, RemoveInvalid=True, RemoveEmpty=True, Tree=sec.Curves)

# ----
path_mapper = PathMapper(clean, source="{A;B;C}(i)", target="{A;B;i}(C)")

# ---- group: split at nulls to establish consecutive lines
data = Data(path_mapper)
null = NullItem(Item=data)  # -> NullFlags, InvalidFlags, Description
lng = ListLength(List=data)
series = Series(Start=0, Step=1, Count=lng)
item = ListItem(List=series, Index=0, Wrap=True)  # -> Item1, Item
cull = CullPattern(List=series, CullPattern=null.NullFlags)
merge = Merge(Data1=item.Item, Data2=cull, Data3=item.Item1)
consec = ConsecutiveDomains(Numbers=merge, Additive=False)

# ----
trim_4 = TrimTree(Tree=consec, Depth=2)

# ---- group: split at nulls to establish consecutive lines (continued)
subset = SubList(List=data, Domain=trim_4, Wrap=True)  # -> List, Index
clean_2 = CleanTree(RemoveNulls=True, RemoveInvalid=True, RemoveEmpty=True, Tree=subset.List)

# ---- group: flip every other curve to make zig zags
dispatch = Dispatch(List=clean_2, DispatchPattern=[True, False])  # -> ListA, ListB
flip = FlipCurve(Curve=dispatch.ListB)  # -> Curve, Flag
weave = Weave(Pattern=[0, 1], Stream0=dispatch.ListA, Stream1=flip.Curve, NullGaps=False)
end = EndPoints(Curve=weave)  # -> Start, End
weave_2 = Weave(Pattern=[0, 1], Stream0=end.Start, Stream1=end.End, NullGaps=False)

# ---- group: split at long line shifts
data_2 = Data(weave_2)
lng_2 = ListLength(List=data_2)
series_2 = Series(Start=0, Step=1, Count=lng_2)
item_2 = ListItem(List=series_2, Index=0, Wrap=True)  # -> Item1, Item

# ---- group: split at long line shifts / if the distance between the end of one line and the start of the next is greater than X * the layer width then create a break
shift = ShiftList(List=data_2, Shift=1, Wrap=True)
dist = Distance(PointA=data_2, PointB=shift)
sift = SiftPattern(List=dist, SiftPattern=[0, 1])  # -> Output0, Output1
multiplication_2 = Multiplication(A=multiplication, B=Slider(2.5, range=0..10))
larger_2 = LargerThan(FirstNumber=sift.Output1, SecondNumber=multiplication_2)  # -> LargerThan, OrEqualTo

# ---- group: split at long line shifts
replace = ReplaceItems(List=larger_2.LargerThan, Item=True, Indices=-1, Wrap=True)
trim_5 = TrimTree(Tree=replace, Depth=1)

cull_2 = CullPattern(List=series_2, CullPattern=trim_5)
merge_2 = Merge(Data1=item_2.Item, Data2=cull_2)
consec_2 = ConsecutiveDomains(Numbers=merge_2, Additive=False)

# ---- group: split at long line shifts / increase start of domain by one unless it is 0
dedomain = DeconstructDomain(Domain=consec_2)  # -> Start, End
addition = Addition(A=dedomain.Start, B=1)
eval = Evaluate(F="if(x=1,0,x)", x=addition)
dom = ConstructDomain(DomainStart=eval, DomainEnd=dedomain.End)

# ---- group: split at long line shifts
trim_6 = TrimTree(Tree=dom, Depth=2)
subset_2 = SubList(List=data_2, Domain=trim_6, Wrap=False)  # -> List, Index
clean_3 = CleanTree(Tree=subset_2.List, CleanInvalid=True, CleanEmpty=False)
prune = PruneTree(Tree=clean_3, Minimum=1, Maximum=0)
pline = PolyLine(Vertices=prune, Closed=False)
trim_to_2 = TrimTo_2(data_to_trim=pline, branch_depth=1, F=False)
D = ClusterOutput(trim_to_2)

# ==== cluster OffsetCompound
inside_crvs = ClusterInput()
outside_crvs = ClusterInput()
distance = ClusterInput()  # Distance to offset curve

# ---- group: Case 3 : muliptle collections of curves and multiple distances
distance_2 = Number(flatten(distance))
outside_crvs_2 = Curve(outside_crvs)
inside_crvs_2 = Curve(inside_crvs)
trim_to = TrimTo_2(data_to_trim=simplify(inside_crvs_2), branch_depth=1, F=False)  # -> graft(D)
trim_to_2 = TrimTo_2(data_to_trim=simplify(outside_crvs_2), branch_depth=1, F=False)  # -> graft(D)
crossref = CrossReference(ListA=trim_to, ListB=distance_2, CrossMode=1)  # -> ListA, ListB
crossref_2 = CrossReference(ListA=trim_to_2, ListB=distance_2, CrossMode=1)  # -> ListA, ListB
offset_out = OffsetOut(curve=crossref.ListA, distance=crossref.ListB, corner_style=3)  # -> crv_5, possibly_problematic_curves
offset_in = OffsetIn(curve=crossref_2.ListA, distance=crossref_2.ListB, corner_style=3)  # -> offset_cruves, possibly_problematic_curves
crv = Curve([offset_in.possibly_problematic_curves, offset_out.possibly_problematic_curves])
crv_2 = ClusterOutput(crv)

# ---- group: Case 3 : muliptle collections of curves and multiple distances / replace problematic curves with chamfered corner curves
offset_in_2 = OffsetIn(curve=offset_in.possibly_problematic_curves, distance=crossref_2.ListB, corner_style=Slider(4, range=0..10))  # -> offset_cruves, possibly_problematic_curves
null = NullItem(Item=offset_in_2.offset_cruves)  # -> NullFlags, InvalidFlags, Description
weave = Weave(Pattern=null.NullFlags, Stream0=offset_in_2.offset_cruves, Stream1=offset_in.offset_cruves, NullGaps=False)
crv_3 = Curve(weave)

# ---- group: Case 3 : muliptle collections of curves and multiple distances / placeholder when there is not internal crvs
lng = ListLength(List=distance_2)
null_2 = Null()
repeat = RepeatData(Data=null_2, Length=lng)
null_3 = NullItem(Item=offset_out.crv_5)  # -> NullFlags, InvalidFlags, Description
weave_2 = Weave(Pattern=null_3.NullFlags, Stream0=offset_out.crv_5, Stream1=repeat, NullGaps=False)

# ---- group: Case 3 : muliptle collections of curves and multiple distances (continued)
path_mapper = PathMapper(weave_2, source="{A;B}(i)", target="{A;i}(B)")
path_mapper_2 = PathMapper(crv_3, source="{A;B}(i)", target="{A;i}(B)")
clean = CleanTree(RemoveNulls=True, RemoveInvalid=True, RemoveEmpty=False, Tree=path_mapper)
crv_4 = Curve(clean)
runion = RegionUnion(Curves=crv_4)
null_4 = NullItem(Item=runion)  # -> NullFlags, InvalidFlags, Description
weave_3 = Weave(Pattern=null_4.NullFlags, Stream0=runion, Stream1=crv_4, NullGaps=False)
trim = TrimTree(Tree=weave_3, Depth=1)
crv_5 = Curve([path_mapper_2, trim])
rdiff = RegionDifference(CurvesA=path_mapper_2, CurvesB=trim)
null_5 = NullItem(Item=rdiff)  # -> NullFlags, InvalidFlags, Description
weave_4 = Weave(Pattern=null_5.NullFlags, Stream0=rdiff, Stream1=crv_5, NullGaps=False)
trim_to_3 = TrimTo_2(data_to_trim=weave_4, branch_depth=1, F=False)

len = Length(Curve=trim_to_3)
sort = SortList(Keys=len, ValuesA=trim_to_3)  # -> Keys, reverse(ValuesA)
split = SplitList(List=sort.ValuesA, Index=1)  # -> ListA, ListB
end = EndPoints(Curve=split.ListA)  # -> Start, End
crv_cp = CurveClosestPoint(Point=end.Start, Curve=split.ListB)  # -> Point, Parameter, Distance
sort_2 = SortList(Keys=crv_cp.Distance, ValuesA=split.ListB)  # -> Keys, ValuesA
merge = Merge(Data1=split.ListA, Data2=sort_2.ValuesA)  # -> simplify(Result)

crv_6 = Curve(merge)
offset_curves = ClusterOutput(crv_6)

# ==== cluster NullCoalescing: Passes the primary data input, unless it is null. In which case it passes the secondary data input to the output. (Like the ?? operator in C#)
primary_data = ClusterInput()  # If this input is not null, it will be passed tot he output.
secondary_data = ClusterInput()  # If the input to the primary data is null, this will be passed to the output.
data = Data(primary_data)
data_2 = Data(secondary_data)
null = NullItem(Item=data)  # -> NullFlags, InvalidFlags, Description
filter = StreamFilter(Gate=null.NullFlags, Stream0=data, Stream1=data_2)
data_3 = Data(filter)
data_4 = ClusterOutput(data_3)

# ==== cluster TrimTo_2: Trim the branches of a tree to a target length.
branch_depth = ClusterInput()  # The target branch depth. A flat terr is 0. {0} is one. {0;0} is two. etc.
data_to_trim = ClusterInput()
int = Integer(branch_depth)
data = Data(data_to_trim)
tstat = TreeStatistics(Tree=data)  # -> Paths, Length, Count
F = ClusterInput()
trim_front = Boolean(F)
split = TextSplit(Text=tstat.Paths, Separators="{;}")
empty = Text("")
mindex = MemberIndex(Set=split, Member=empty)  # -> Index, Count
cull_i = CullIndex(List=split, Indices=mindex.Index, Wrap=True)
dom = ConstructDomain(DomainStart=0, DomainEnd=expr("x-1", int))

lng = ListLength(List=cull_i)
subtraction = Subtraction(A=lng, B=int)

max = Maximum(A=0, B=subtraction)

dom_2 = ConstructDomain(DomainStart=max, DomainEnd=expr("x-1", lng))

filter = StreamFilter(Gate=trim_front, Stream0=dom, Stream1=dom_2)
subset = SubList(List=cull_i, Domain=filter, Wrap=False)  # -> List, Index
path = ConstructPath(Indices=subset.List)  # -> flatten(Branch)
replace = ReplacePaths(Data=data, Search=tstat.Paths, Replace=path)
D = ClusterOutput(replace)

# ==== cluster OffsetIn: Offsets curves inward. Use for extranal curves.
curve = ClusterInput()  # Offset curves inward. Use for exterior curves.
distance = ClusterInput()  # Distance(s) to offset curve(s)
corner_style = ClusterInput()

# ---- group: if fed a config use 1/2 extrusion width, otherwise pass data
distance_2 = Number(distance)

# ---- group: exterior
crv = Curve(curve)

# ---- group: run a test offset and check to see if it is smaller
D = Number(distance_2)
offset = Offset(Curve=crv, Distance=D, Plane=PlaneXY(0, 0, 0), Corners=corner_style)
trim = TrimTree(Tree=offset, Depth=1)
area = Area(Geometry=trim)  # -> Area, Centroid
area_2 = Area(Geometry=crv)  # -> Area, Centroid
smaller = SmallerThan(FirstNumber=area.Area, SecondNumber=area_2.Area)  # -> SmallerThan, OrEqualTo

# ---- group: use test offset to determine the direction of the final offset
D_2 = Number(distance_2)
long = LongestList(ListA=smaller.SmallerThan, ListB=D_2, PaddingMode=2)  # -> ListA, ListB
neg = Negative(Value=long.ListB)
p_n_c = PickNChoose(Pattern=smaller.SmallerThan, Stream0=neg, Stream1=long.ListB)
offset_2 = Offset(Curve=crv, Distance=p_n_c, Plane=PlaneXY(0, 0, 0), Corners=corner_style)
trim_2 = TrimTree(Tree=offset_2, Depth=1)

# ---- group: double check and just ditch what isn't right
area_3 = Area(Geometry=trim_2)  # -> Area, Centroid
area_4 = Area(Geometry=crv)  # -> Area, Centroid
smaller_2 = SmallerThan(FirstNumber=area_3.Area, SecondNumber=area_4.Area)  # -> SmallerThan, OrEqualTo
dispatch = Dispatch(List=trim_2, DispatchPattern=smaller_2.SmallerThan)  # -> ListA, ListB
crv_2 = Curve(dispatch.ListB)

# ---- group: double check and just ditch what isn't right / good exterior offsets
crv_3 = Curve(dispatch.ListA)

# ----
offset_cruves = ClusterOutput(crv_3)

bnd = Bounds(Numbers=flatten(distance_2))
pi = Pi(Factor=1)
dedomain = DeconstructDomain(Domain=bnd)  # -> Start, End
len = Length(Curve=crv_3)
len_2 = Length(Curve=crv)
multiplication = Multiplication(A=dedomain.End, B=pi)
division = Division(A=len, B=len_2)
larger = LargerThan(FirstNumber=division, SecondNumber=0.5)  # -> LargerThan, OrEqualTo

smaller_3 = SmallerThan(FirstNumber=len, SecondNumber=multiplication)  # -> SmallerThan, OrEqualTo

or = GateOr(A=larger.LargerThan, B=smaller_3.SmallerThan)
dispatch_2 = Dispatch(List=crv, DispatchPattern=or)  # -> ListA, ListB
crv_4 = Curve(dispatch_2.ListB)
possibly_problematic_curves = ClusterOutput(crv_4)  # These are the orginal input curves whose offset resulted in a crv that was less than 50% of the original length (and not simply due to strating as a small curve.

# ==== cluster OffsetOut: Offset curves outward. Use for interior curves.
curve = ClusterInput()  # Offset curves inward. Use for exterior curves.
distance = ClusterInput()  # Distance(s) to offset curve(s)
corner_style = ClusterInput()
distance_2 = Number(distance)

# ---- group: interior
crv = Curve(curve)

# ---- group: run a test offset and check to see if it is bigger
D = Number(distance_2)
offset = Offset(Curve=crv, Distance=D, Plane=PlaneXY(0, 0, 0), Corners=corner_style)
trim = TrimTree(Tree=offset, Depth=1)
area = Area(Geometry=trim)  # -> Area, Centroid
area_2 = Area(Geometry=crv)  # -> Area, Centroid
larger = LargerThan(FirstNumber=area.Area, SecondNumber=area_2.Area)  # -> LargerThan, OrEqualTo

# ---- group: use test offset to determine the direction of the final offset
D_2 = Number(distance_2)
long = LongestList(ListA=larger.LargerThan, ListB=D_2, PaddingMode=2)  # -> ListA, ListB
neg = Negative(Value=long.ListB)
p_n_c = PickNChoose(Pattern=larger.LargerThan, Stream0=neg, Stream1=long.ListB)
offset_2 = Offset(Curve=crv, Distance=p_n_c, Plane=PlaneXY(0, 0, 0), Corners=corner_style)
trim_2 = TrimTree(Tree=offset_2, Depth=1)

# ---- group: double check and just ditch what isn't right
area_3 = Area(Geometry=trim_2)  # -> Area, Centroid
area_4 = Area(Geometry=crv)  # -> Area, Centroid
larger_2 = LargerThan(FirstNumber=area_3.Area, SecondNumber=area_4.Area)  # -> LargerThan, OrEqualTo
dispatch = Dispatch(List=trim_2, DispatchPattern=larger_2.LargerThan)  # -> ListA, ListB
crv_2 = Curve(dispatch.ListB)

# ---- group: double check and just ditch what isn't right / good interior offsets
crv_3 = Curve(dispatch.ListA)

# ----
len = Length(Curve=crv_3)
len_2 = Length(Curve=crv)
bnd = Bounds(Numbers=distance_2)
pi = Pi(Factor=1)
dedomain = DeconstructDomain(Domain=bnd)  # -> Start, End
division = Division(A=len, B=len_2)
larger_3 = LargerThan(FirstNumber=division, SecondNumber=0.5)  # -> LargerThan, OrEqualTo
multiplication = Multiplication(A=dedomain.End, B=pi)
or = GateOr(A=larger_3.LargerThan, B=multiplication)
dispatch_2 = Dispatch(List=crv, DispatchPattern=or)  # -> ListA, ListB
crv_4 = Curve(dispatch_2.ListB)
possibly_problematic_curves = ClusterOutput(crv_4)  # These are the orginal input curves whose offset resulted in a crv that was less than 50% of the original length.

crv_5 = ClusterOutput(crv_3)
